vi "index.gviweb"   [LabVIEW NXG 5.0.0]
panel controls:
  "Stop Data Collection": bool
  "Start Data Collection": bool
  "Save Data": bool
panel indicators:
  "headers": string
  "body": string
  "Temperature": f64
  "Chassis Temperature": f64
  "HTML Execution Time (sec)": f64
uses:
  NI::HTTP::GET.gvi
diagram:
  s1 = uninitialised  # shift register
  while {
    Get Current Time() -> (current time=w1)
    Timestamp Subtract(x=w1, y=s1) -> w2
    $"HTML Execution Time (sec)" <- w2
    Build Array($"Save Data", $"Stop Data Collection", $"Start Data Collection") -> w3
    Or Array Elements(Boolean array=w3) -> (logical OR=w4)
    case (w4) {
      frame False, Default { }
      frame True {
        Boolean To 0 Or 1(Boolean=$"Stop Data Collection") -> (0, 1=w5)
        Number To Decimal String(number=w5, width (-)=0) -> (decimal integer string=w6)
        Boolean To 0 Or 1(Boolean=$"Save Data") -> (0, 1=w7)
        Number To Decimal String(number=w7, width (-)=0) -> (decimal integer string=w8)
        Boolean To 0 Or 1(Boolean=$"Start Data Collection") -> (0, 1=w9)
        Number To Decimal String(number=w9, width (-)=0) -> (decimal integer string=w10)
        Concatenate Strings("http://127.0.0.1:80/TutorialService/FPGA?save_file=", w8, "&stop=", w6, "&getdata=", w10) -> w11
        # If a button is pressed, post data to LabVIEW Web service, unflatten the  response data, format the data, and display on graph/indicator
        call "GET.gvi"(url=w11) -> (headers=w12, body=w13)
        $headers <- w12
        $body <- w13
        s2 = w13  # shift register
        while {
          Match Pattern(regular expression=",", string=s2) -> (after substring=w15, before substring=w16)
          Match Pattern(regular expression=":", string=w16) -> (after substring=w17)
          Scan Value(format string="%f", string=w17) -> (value=w18)
          Is Empty String Or Path(string/path=w15) -> w19
          append w18 to w14
          next s2 = w15
          stop if w19
        }
        Array Index(array=w14) -> (out0[0]=w20)
        $Temperature <- w20
        $"Chassis Temperature" <- w20
      }
    }
    Wait(time to wait=100)
    next s1 = w1
    stop if FALSE
  }
