vi "index.gviweb"   [LabVIEW NXG 5.0.0]
panel controls:
  "Stop cRIO": bool
  "Log Data Point": bool
  "Save Data": bool
  "Turn on cRIO": bool
  "IP Address and Port": string = "http://192.168.1.130:8080/cRIO_Web_Service/Get_Method_Resource?start="
panel indicators:
  "headers": string
  "body": string
  "Temperature": f64
  "Chassis Temperature": f64
  "HTML Execution Time (sec)": f64
  "error out": error
uses:
  NI::HTTP::GET.gvi
diagram:
  s1 = uninitialised  # shift register
  while {
    Get Current Time() -> (current time=w1)
    Timestamp Subtract(x=w1, y=s1) -> w2
    $"HTML Execution Time (sec)" <- w2
    Build Array($"Turn on cRIO", $"Log Data Point", $"Stop cRIO", $"Save Data") -> w3
    Or Array Elements(Boolean array=w3) -> (logical OR=w4)
    case (w4) {
      frame False, Default { }
      frame True {
        Boolean To 0 Or 1(Boolean=$"Stop cRIO") -> (0, 1=w5)
        Number To Decimal String(number=w5, width (-)=0) -> (decimal integer string=w6)
        Boolean To 0 Or 1(Boolean=$"Log Data Point") -> (0, 1=w7)
        Number To Decimal String(number=w7, width (-)=0) -> (decimal integer string=w8)
        Boolean To 0 Or 1(Boolean=$"Save Data") -> (0, 1=w9)
        Number To Decimal String(number=w9, width (-)=0) -> (decimal integer string=w10)
        Boolean To 0 Or 1(Boolean=$"Turn on cRIO") -> (0, 1=w11)
        Number To Decimal String(number=w11, width (-)=0) -> (decimal integer string=w12)
        Concatenate Strings($"IP Address and Port", w12, "&getdata=", w8, "&stop=", w6, "&save_file=", w10) -> w13
        call "GET.gvi"(url=w13) -> (headers=w14, body=w15, error out=w16)
        # If a button is pressed, post data to LabVIEW Web service, unflatten the  response data, format the data, and display on graph/indicator
        $"error out" <- w16
        $headers <- w14
        $body <- w15
        s2 = w15  # shift register
        while {
          Match Pattern(regular expression=",", string=s2) -> (after substring=w18, before substring=w19)
          Match Pattern(regular expression=":", string=w19) -> (after substring=w20)
          Scan Value(format string="%f", string=w20) -> (value=w21)
          Is Empty String Or Path(string/path=w18) -> w22
          append w21 to w17
          next s2 = w18
          stop if w22
        }
        Array Index(array=w17) -> (out0[0]=w23)
        $Temperature <- w23
        $"Chassis Temperature" <- w23
      }
    }
    Wait(time to wait=100)
    next s1 = w1
    stop if FALSE
  }
