vi "index.gviweb"   [LabVIEW NXG 5.0.0]
panel controls:
  "a": f64 = 1
  "b": f64 = 25
  "Hyperlink Control": string = "https://github.com/ni/webvi-examples"
  "Hyperlink Control_2": string = "https://github.com/ni/webvi-examples/tree/ad0a92c4696674f290b4e2a02c514360be7b299d/Call%20LabVIEW%20Web%20Service"
  "URL Configuration": T1 = "Use Absolute URLs and Local Debugging"
  "selector": enum{"Add", "Subtract"} = "Add"
panel indicators:
  "banner": string
  "headers": string
  "body": string
types:
  T1 = enum{"Use Absolute URLs and Local Debugging", "Use Relative URLs and Application Web Server"}
uses:
  NI::HTTP::GET.gvi
diagram:
  # Get data from LabVIEW Web service, unflatten the data, and format it so it can be displayed in a single graph.
  #
  # Post data to LabVIEW Web service, unflatten the  response data, format the data, and plot on two graphs
  s1 = $"URL Configuration"  # shift register
  while {
    case (s1) {
      frame "Use Absolute URLs and Local Debugging", Default {
        w1 = "http://127.0.0.1:80/TutorialService/"
      }
      frame "Use Relative URLs and Application Web Server" {
        w1 = ""
      }
    }
    w2 = $b
    w3 = $a
    event (after s1) {
      on "URL Configuration" Value changed {
        w4 = $"URL Configuration"
        w5 = default
        w6 = default
      }
      on "a" Value changed; "b" Value changed {
        case ($selector) {
          frame "Add", Default {
            Number To Fractional String(number=w2, precision (6)=4) -> (F-format string=w7)
            Number To Fractional String(number=w3, precision (6)=4) -> (F-format string=w8)
            Concatenate Strings(w1, "Add?b=", w7, "&a=", w8) -> w9
            call "GET.gvi"(url=w9) -> (headers=w5, body=w6)
          }
          frame "Subtract" {
            Number To Fractional String(number=w2, precision (6)=4) -> (F-format string=w10)
            Number To Fractional String(number=w3, precision (6)=4) -> (F-format string=w11)
            Concatenate Strings(w1, "AdditionalOperations/Subtract?b=", w10, "&a=", w11) -> w12
            call "GET.gvi"(url=w12) -> (headers=w5, body=w6)
          }
        }
        w4 = default
      }
    }
    $headers <- w5
    $body <- w6
    next s1 = w4
    stop if FALSE
  }
