vi "Set Signal Parameters.gviweb"   [LabVIEW NXG 5.0.0]
inputs:
  "String": string
  "Sample Length (s)": i32 = 10
  "Sample Rate (Hz)": i32 = 100
  "Signal Frequency": f64 = 1
  "Signal Amplitude": f64 = 1
  "Noise %": f64 = 25
  "error in": error
outputs:
  "Spectrum": cluster{"Element 1": f64, "Element 2": f64}[]
  "Signal": cluster{"Element 1": f64, "Element 2": f64}[]
  "error out": error
types:
  T1 = cluster{"Samples": i32, "Amplitude": f64, "Frequency": f64, "Noise%": f64}
uses:
  NI::HTTP::POST Buffer.gvi
diagram:
  Divide(x=$"Sample Rate (Hz)", y=2) -> w1
  Reciprocal(x=$"Sample Length (s)") -> w2
  Multiply($"Sample Length (s)", $"Sample Rate (Hz)") -> w3
  Divide(x=$"Signal Frequency", y=$"Sample Rate (Hz)") -> w4
  Property Node(instance in=T1 {all zero or empty}, "Samples"=w3, "Frequency"=w4, "Amplitude"=$"Signal Amplitude", "Noise%"=$"Noise %") -> (instance out=w5)
  Flatten To Json(anything=w5, error in (no error)=$"error in") -> (JSON string=w6, error out=w7)
  call "POST Buffer.gvi"(url=$String, buffer=w6, error in=w7) -> (body=w8, error out=w9)
  w10 = cluster{"Signal": f64[], "Spectrum": f64[]} {all zero or empty}
  Unflatten From Json(JSON string=w8, error in (no error)=w9, type and defaults=w10) -> (error out=w11, value=w12)
  Property Node(instance in=w12) -> ("Spectrum"=w13, "Signal"=w14)
  for (iteration -> i1) {
    w15 = each element of w13
    Multiply(w2, i1) -> w17
    Build Cluster(w17, w15) -> w18
    Is Greater(x=w17, y=w1) -> w19
    append w18 to w16
    stop if w19
  }
  $Spectrum <- w16
  Reciprocal(x=$"Sample Rate (Hz)") -> w20
  for (iteration -> i2) {
    w21 = each element of w14
    Multiply(i2, w20) -> w23
    Build Cluster(w23, w21) -> w24
    append w24 to w22
  }
  $Signal <- w22
  $"error out" <- w11
